# Grasshopper definition Kinect Lego.gh (Grasshopper 0.9.76)
# plug-ins: Python Interpreter, Quokka

# ---- group: Int Grid X Extent
number_slider = Slider(8, range=1..20)

# ---- group: Int Grid Y Extent
number_slider_2 = Slider(8, range=1..20)

# ----
pt = Point(Point(-54.45211369, 811.7043425, -26.46586292))
pt_2 = Point(Point(-40.51806211, 812.0155781, 261.5315261))
pt_3 = Point(Point(313.1940084, 811.542608, 261.2161429))
pt_4 = Point(Point(305.1281058, 811.8686289, -35.91931469))
merge = Merge(Data1=pt_4, Data2=pt, Data3=pt_2, Data4=pt_3)
height = Slider(0, range=-10000..10000)
height_2 = Slider(400, range=-10000..10000)
depth = Slider(0, range=-10000..10000)
trim_y = Slider(0, range=0..319)
trim_y_2 = Slider(639, range=0..639)
trim_y_3 = Slider(0, range=0..239)
trim_y_4 = Slider(479, range=0..479)
width = Slider(0, range=-10000..10000)
width_2 = Slider(250, range=-10000..10000)
depth_2 = Slider(800, range=-10000..10000)

# ---- group: gridExtent_x
int = Integer(number_slider)

# ---- group: Pts Sample Grid Corner
pt_5 = Point(merge)

# ---- group: gridExtent_y
int_2 = Integer(number_slider_2)

# ----
scale = Slider(1, range=0..1)
panel = Panel(pt_5)
multiplication = Multiplication(A=int, B=2)
multiplication_2 = Multiplication(A=int_2, B=2)
players = BooleanToggle(True)
colour = BooleanToggle(True)
scene = BooleanToggle(True)
bones = BooleanToggle(False)
joints = BooleanToggle(True)

nth_x = Slider(10, range=1..200)
nth_y = Slider(10, range=1..200)

perspective = Perspective(int_2=multiplication, int=multiplication_2, pt=pt_5)
dom = Domain(DomainStart=depth_2, DomainEnd=depth)
dom_2 = Domain(DomainStart=width_2, DomainEnd=width)
dom_3 = Domain(DomainStart=height_2, DomainEnd=height)
dom_4 = Domain(DomainStart=trim_y_3, DomainEnd=trim_y_4)
dom_5 = Domain(DomainStart=trim_y, DomainEnd=trim_y_2)
pline = PolyLine(Vertices=pt_5, Closed=False)
quokka_trim_opt = QuokkaTrimOptions(Scale=scale, X=dom_5, Y=dom_4, Width=dom_2, Depth=dom, Height=dom_3)
quokka_disp_opt = QuokkaDisplayOptions(Players=players, Scene=scene, Colour=colour, Joints=joints, Bones=bones)
sph = Sphere(Base=panel, Radius=Slider(9, range=1..20))
number_slider_3 = Slider(3, range=1..20)  # disabled
srf4pt = _4PointSurface(CornerA=pt_4, CornerB=pt, CornerC=pt_2, CornerD=pt_3)
timer = Timer(TimerInterval=100, Target=quokka)
nth_x_2 = Slider(4, range=1..200)
preview = CustomPreview(Geometry=[sph, pline], Shader=ColourSwatch(SwatchColor=RGB(255, 242, 0)))

# ---- group: keystoned grid pts
pt_6 = Point(perspective)

# ----
quokka = Quokka(NthX=nth_x, NthY=nth_y, DisplayOptions=quokka_disp_opt, TrimOptions=quokka_trim_opt)  # -> Out, Points, Colour, Joints, Bones
sph_2 = Sphere(Base=quokka.Points, Radius=nth_x_2)
pt_7 = Point(flatten(pt_6))
points = PointList(Points=flatten(pt_6), Size=number_slider_3)  # disabled
python = PythonScript(points=pt_7, x=number_slider, y=number_slider_2)  # -> out, a, b, c, d; inputs points: list
# ---------- python: Python ----------
x = int(x)
y = int(y)

print len(points)

a = [points[i] for i in range(len(points)) if i%(x*2) < x*2-1 and i/(x*2) < y*2-1 ]
b = [points[i+1] for i in range(len(points)) if i%(x*2) < x*2-1 and i/(x*2)< y*2-1 ]
c = [points[i+1+x*2] for i in range(len(points)) if i%(x*2) < x*2-1 and i/(x*2)< y*2-1 ]
d =[points[i+x*2] for i in range(len(points)) if i%(x*2) < x*2-1 and i/(x*2)< y*2-1 ]
# ---------- end python ----------
preview_2 = CustomPreview(Geometry=sph_2, Shader=quokka.Colour)
md_slider = MDSlider(slider_value=Point(0.5, 0.5, 0.5), SliderMode=0, x_domain=Domain(0, 1), y_domain=Domain(0, 1), z_domain=Domain(0, 1))
srf4pt_2 = _4PointSurface(CornerA=python.a, CornerB=python.b, CornerC=python.c, CornerD=python.d)
pt_8 = Point(flatten(quokka.Points))
pshift = ShiftPaths(Data=srf4pt_2, Offset=-1)
evalsrf = EvaluateSurface(Surface=srf4pt_2, Point=md_slider)  # -> Point, Normal, Frame

lego_brick = Slider(1.8, range=0..3.6)  # disabled
number_slider_4 = Slider(20, range=0..96)  # disabled
pt_9 = ConstructPoint(XCoordinate=0, YCoordinate=0, ZCoordinate=0)  # disabled
panel_2 = Panel(quokka_trim_opt)  # disabled
plfit = PlaneFit(Points=flatten(quokka.Points))  # -> Plane, Deviation; disabled
series = Series(Start=0, Step=lego_brick, Count=number_slider_4)  # -> graft(Series); disabled
series_2 = Series(Start=0, Step=lego_brick, Count=number_slider_4)  # disabled
project = Project(Geometry=quokka.Points, Plane=plfit.Plane)  # -> Geometry, Transform; disabled
multiplication_3 = Multiplication(A=lego_brick, B=number_slider_4)  # disabled
Y = UnitY(Factor=series_2)  # disabled
X = UnitX(Factor=series)  # disabled
ln = Line(StartPoint=quokka.Points, EndPoint=project.Geometry)  # disabled
move = Move(Geometry=pt_9, Motion=Y)  # -> Geometry, Transform; disabled
orient = Orient(Geometry=ln, Source=plfit.Plane, Target=PlaneXY(0, 0, 0))  # -> Geometry, Transform; disabled
pt_10 = ConstructPoint(XCoordinate=multiplication_3, YCoordinate=multiplication_3, ZCoordinate=multiplication_3)  # disabled
move_2 = Move(Geometry=move.Geometry, Motion=X)  # -> Geometry, Transform; disabled
group = Group(Objects=flatten(orient.Geometry))  # disabled
box = Box2Pt(PointA=pt_9, PointB=pt_10, Plane=PlaneXY(0, 0, 0))  # disabled
planesrf = PlaneSurface(Plane=move_2.Geometry, XSize=lego_brick, YSize=lego_brick)  # -> flatten(Plane); disabled
bbox = BoundingBox(Content=group, Plane=PlaneXY(0, 0, 0))  # -> Box, Box_2; disabled
morph = BoxMorph(Geometry=orient.Geometry, Reference=bbox.Box, Target=box)  # disabled
number_slider_5 = Slider(5.48, range=0..10)  # disabled
len = Length(Curve=morph)  # disabled
larger = LargerThan(FirstNumber=len, SecondNumber=number_slider_5)  # -> LargerThan, OrEqualTo; disabled
cull = CullPattern(List=morph, CullPattern=larger.LargerThan)  # -> flatten(List); disabled
end = EndPoints(Curve=cull)  # -> Start, End; disabled
project_2 = ProjectPoint(Point=end.End, Direction=Vector(0, 0, -1), Geometry=planesrf)  # -> Point, Index; disabled
sort = SortList(Keys=project_2.Index)  # -> Keys, ValuesA; disabled
dcon = DeleteConsecutive(Set=sort.Keys, Wrap=False)  # -> Set, Count; disabled
item = ListItem(List=planesrf, Index=dcon.Set, Wrap=True)  # disabled

line = LineSDL(Start=pt_8, Direction=evalsrf.Normal, Length=Slider(-100, range=-1000..1000))
graft = GraftTree(Tree=pshift, IncludeEmptyLists=True, IncludeNullItems=True)
blx = BrepLine(Brep=graft, Line=line, LimitToFirst=False)  # -> Curves, Points
pshift_2 = ShiftPaths(Data=blx.Points, Offset=-1)
item_2 = ListItem(List=pshift_2, Index=0, Wrap=False)
pdecon = Deconstruct(Point=item_2)  # -> XComponent, YComponent, ZComponent
nullrep = ReplaceNulls(Items=pdecon.YComponent, Replacements=Slider(0, range=0..100))  # -> Items, Count
data = Data(flatten(nullrep.Items))
bnd = Bounds(Numbers=data)
dedomain = DeconstructDomain(Domain=bnd)  # -> Start, End
dom_6 = ConstructDomain(DomainStart=Slider(0, range=0..100), DomainEnd=Slider(1, range=0..1))
dom_7 = ConstructDomain(DomainStart=dedomain.Start, DomainEnd=dedomain.End)
remap = RemapNumbers(Value=nullrep.Items, Source=dom_7, Target=dom_6)  # -> Mapped, Clipped
pow = Power(A=Slider(81, range=0..100), B=remap.Mapped)
Y_2 = UnitY(Factor=pow)
move_3 = Move(Geometry=srf4pt_2, Motion=flatten(Y_2))  # -> Geometry, Transform

# ==== cluster Perspective
int = ClusterInput()
int_2 = ClusterInput()
pt = ClusterInput()

# ---- group: grid extent y
int_3 = Integer(int)

# ---- group: grid extent x
int_4 = Integer(int_2)

# ---- group: Pts Sample Grid Corner
pt_2 = Point(pt)

# ----
subtraction = Subtraction(A=int_4, B=1)
subtraction_2 = Subtraction(A=int_3, B=1)
item = ListItem(List=pt_2, Index=2, Wrap=False)
item_2 = ListItem(List=pt_2, Index=3, Wrap=False)
item_3 = ListItem(List=pt_2, Index=0, Wrap=False)
item_4 = ListItem(List=pt_2, Index=1, Wrap=False)
pt_3 = Point(item_2)
pt_4 = Point(item_3)
ln = Line(StartPoint=pt_3, EndPoint=pt_4)
pt_5 = Point(item_4)
ln_2 = Line(StartPoint=pt_4, EndPoint=pt_5)
pt_6 = Point(item)
ln_3 = Line(StartPoint=pt_6, EndPoint=pt_3)
ln_4 = Line(StartPoint=pt_5, EndPoint=pt_6)
llx = LineLine(Line1=ln, Line2=ln_4)  # -> ParamA, ParamB, PointA, PointB
pt_7 = Point(llx.PointA)
llx_2 = LineLine(Line1=ln_2, Line2=ln_3)  # -> ParamA, ParamB, PointA, PointB
pt_8 = Point(llx_2.PointA)
vec2pt = Vector2Pt(PointA=pt_8, PointB=pt_7, Unitize=False)  # -> Vector, Length
line = LineSDL(Start=pt_3, Direction=vec2pt.Vector, Length=1)
llx_3 = LineLine(Line1=ln_2, Line2=line)  # -> ParamA, ParamB, PointA, PointB
pt_9 = Point(llx_3.PointA)
ln_5 = Line(StartPoint=pt_3, EndPoint=pt_9)
divide = DivideCurve(Curve=ln_5, Count=subtraction_2, Kinks=False)  # -> Points, Tangents, Parameters
ln_6 = Line(StartPoint=pt_8, EndPoint=divide.Points)
llx_4 = LineLine(Line1=ln_4, Line2=line)  # -> ParamA, ParamB, PointA, PointB
pt_10 = Point(llx_4.PointA)
ln_7 = Line(StartPoint=pt_3, EndPoint=pt_10)
divide_2 = DivideCurve(Curve=ln_7, Count=subtraction, Kinks=False)  # -> Points, Tangents, Parameters
ln_8 = Line(StartPoint=pt_7, EndPoint=divide_2.Points)
ln_9 = Line(StartPoint=pt_8, EndPoint=pt_7)

# ---- group: x
line_2 = Line(ln_8)

# ---- group: y
line_3 = Line(ln_6)

# ----
graft = GraftTree(Tree=ln_6, IncludeEmptyLists=True, IncludeNullItems=True)
llx_5 = LineLine(Line1=line_2, Line2=graft)  # -> ParamA, ParamB, PointA, PointB

# ---- group: keystoned grid pts
pt_11 = Point(llx_5.PointA)

# ----
pt_12 = ClusterOutput(pt_11)
