# Grasshopper definition LEGOTIZER.gh (Grasshopper 0.9.76)
# plug-ins: Human

number_slider = Slider(68, range=0..78)
lego_brick = Slider(0.8, range=0..0.8)
number_slider_2 = Slider(192, range=0..192)
panel = Panel("Lego Bricks Grids")
lego_brick_2 = Slider(-0.4, range=-1..1)
pt = ConstructPoint(XCoordinate=0, YCoordinate=0, ZCoordinate=Slider(100, range=0..100))
circle = CircleCNR(Center=pt, Normal=Vector(0, 0, 1), Radius=10)
Y = UnitY(Factor=1)
multiplication = Multiplication(A=lego_brick, B=number_slider)
multiplication_2 = Multiplication(A=lego_brick, B=number_slider_2)
series = Series(Start=0, Step=lego_brick, Count=number_slider)
series_2 = Series(Start=0, Step=lego_brick, Count=number_slider_2)  # -> graft(Series)
pt_2 = Point(pt)
Y_2 = UnitY(Factor=series)
X = UnitX(Factor=lego_brick_2)
X_2 = UnitX(Factor=series_2)
line = LineSDL(Start=X_2, Direction=Y, Length=multiplication)
move = Move(Geometry=pt_2, Motion=Y_2)  # -> Geometry, Transform
move_2 = Move(Geometry=line, Motion=X)  # -> Geometry, Transform
item = ListItem(List=flatten(move_2.Geometry), Index=0, Wrap=True)
move_3 = Move(Geometry=move.Geometry, Motion=X_2)  # -> flatten(Geometry), Transform
lego_brick_3 = Slider(-0.4, range=-1..1)
panel_2 = Panel("projection to surfaces")
divide = DivideCurve(Curve=item, Count=number_slider, Kinks=False)  # -> Points, Tangents, Parameters
X_3 = UnitX(Factor=1)
mesh = Mesh(graft([<mesh referenced from the Rhino model> x4]))
Z = UnitZ(Factor=-1)
line_2 = LineSDL(Start=divide.Points, Direction=X_3, Length=multiplication_2)
meshray = MeshRay(Mesh=mesh, Point=move_3.Geometry, Direction=Z)  # -> Point, Hit
Y_3 = UnitY(Factor=lego_brick_3)
flip = FlipMatrix(Data=meshray.Point)
move_4 = Move(Geometry=line_2, Motion=Y_3)  # -> Geometry, Transform
clean = CleanTree(RemoveNulls=True, RemoveInvalid=True, RemoveEmpty=False, Tree=flip)
merge = Merge(Data1=move_4.Geometry, Data2=move_2.Geometry)
pdecon = Deconstruct(Point=clean)  # -> XComponent, YComponent, ZComponent
# select hiegest Z from multiple lists
# -- Ryan --
sort = SortList(Keys=pdecon.ZComponent)  # -> Keys, ValuesA
rev = ReverseList(List=sort.Keys)
item_2 = ListItem(List=rev, Index=0, Wrap=False)
lego_brick_height = Slider(0.96, range=0..0.96)
# Round down to Lego Unit height
division = Division(A=item_2, B=lego_brick_height)
# Height of lego unit
int = Integer(division)
multiplication_3 = Multiplication(A=int, B=lego_brick_height)
pt_3 = ConstructPoint(XCoordinate=pdecon.XComponent, YCoordinate=pdecon.YComponent, ZCoordinate=multiplication_3)
pdecon_2 = Deconstruct(Point=pt_3)  # -> XComponent, YComponent, ZComponent
int_2 = Integer(pdecon_2.ZComponent)
bnd = Bounds(Numbers=flatten(int_2))
domcomp = DomainComponents(Domain=bnd)  # -> Start, End
panel_3 = Panel("Height Numbers Rendring")
gradient = Gradient(
    LowerLimit=domcomp.Start,
    UpperLimit=domcomp.End,
    Parameter=int_2,
    stops=[0: RGB(0, 128, 0), 0.501: RGB(255, 255, 0), 1: RGB(255, 0, 0)])
lego_brick_height_2 = Slider(0.4, range=0..0.96)
justified_text = JustifiedText3d(
    Location=pt_3,
    Text=int_2,
    Size=lego_brick_height_2,
    Color=gradient,
    HorizontalAlignment=1,
    VerticalAlginment=1,
    UseMeshes=False,
    Bake=Toggle(False))
